# Grasshopper definition Example.gh (Grasshopper 1.0.7)
# plug-ins: ReadGeoJSONMetaData

panel = Panel("C:\Users\Paula\Desktop\Felipe\GUNClub\Data\CurvasNivel\ClippedCNiv.shp")
readshp = ReadShapefile(PathToFile=panel, ParallelComputation=Toggle(False))  # -> CatchErrors, LatitudeOfGeometry, LongitudeOfGeometry, AltitudeOfGeometry, CullPattern
bool = Boolean(Tree({0}: [True], {1}: [False], {2}: [True], {3}: [True], {4}: [True], {5}: [True]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))
num = Number(Tree({0}: [4.663929819, 4.663929214, 4.663928834, 4.663928527, 4.663928346, 4.663928075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], {2}: [4.66427, 4.664257714, 4.66424093, 4.664230319, 4.664218262, 4.664207823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], {3}: [4.662784, 4.662793935, 4.662796791, 4.662800317, 4.662804004, 4.662806364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], {4}: [4.66427, 4.664258283, 4.664246371, 4.664237108, 4.664229489, 4.664223959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], {5}: [4.66427, 4.664262269, 4.664255382, 4.664248513, 4.664240215, 4.664232036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], {7}: [4.662784, 4.662788085, 4.662789737, 4.662795177, 4.662808879, 4.662817854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]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))
expression = Expression(x=num, y=readshp.LatitudeOfGeometry, Expression="If( ( x - y ) < 0.0001, False, True )")
shpfields = ShapeFileFieldExtractor(PathToFile=panel, FieldToSelect=Slider(2, range=0..10))  # -> CatchErrors, NumberOfFeatures, Fields, OutputField, GeometryType
equals = Equality()  # -> Equality, Inequality
panel_2 = Panel(readshp.CatchErrors)
proj = Projections(ParallelComputing=Toggle(False), Latitude=readshp.LatitudeOfGeometry, Longitude=readshp.LongitudeOfGeometry)  # -> ProjectedPoints, Erros
panel_3 = Panel(readshp.LatitudeOfGeometry)
bbox = BoundingBox(Content=flatten(proj.ProjectedPoints), Plane=PlaneXY(0, 0, 0), UnionBox=True)  # -> Box, Box_2
cull = CullPattern(List=flatten(shpfields.OutputField), CullPattern=flatten(readshp.CullPattern))
area = Area(Geometry=bbox.Box, UseTasks=False)  # -> Area, Centroid
subtraction = Subtraction(A=Slider(2568, range=0..10000), B=cull)
Z = UnitZ(Factor=subtraction)
scale = Scale(Geometry=proj.ProjectedPoints, Center=area.Centroid, Factor=Slider(1000, range=0..1000))  # -> Geometry, Transform
move = Move(Geometry=scale.Geometry, Motion=graft(Z))  # -> Geometry, Transform
pt = ConstructPoint(XCoordinate=0, YCoordinate=0, ZCoordinate=0)
vec2pt = Vector2Pt(PointA=area.Centroid, PointB=pt, Unitize=False)  # -> Vector, Length
move_2 = Move(Geometry=move.Geometry, Motion=vec2pt.Vector)  # -> Geometry, Transform
pline = PolyLine(Vertices=move_2.Geometry, Closed=False)
